# Grasshopper definition hops_test_with_electrical_room.gh (Grasshopper 1.0.8)
# plug-ins: Hops

hops = Hops(
    RoomWidthFeet=Slider(12, range=3..20),
    RoomLengthFeet=Slider(4.5, range=3..20),
    PanelboardCount=Slider(4, range=0..10),
    TransformerCount=Slider(2, range=0..10),
    CacheResultsInMemory=True,
    CacheSolveResults=True,
    RemoteDefinitionLocation="C:\Users\scleb\Documents\bimsc25\GitHub\grasshopper_electrical_room_layout\gh_files\electrical_room_layout.gh",
    RemoteSolveVersion=(0, 1, 0),
    ShowInput_Enabled=False,
    ShowInput_Path=False,
    SynchronousSolve=True)  # -> Geometry, Messages
panel = Panel(hops.Messages)
entwine = Entwine(
    Branch00=ColourSwatch(SwatchColor=RGB(59, 59, 59)),
    Branch01=ColourSwatch(SwatchColor=RGBA(255, 0, 0, 64)),
    Branch02=ColourSwatch(SwatchColor=RGBA(158, 109, 109, 82)),
    FlattenInputs=True)
preview = CustomPreview(Geometry=hops.Geometry, Material=entwine)
